# Grasshopper definition Alexander Nasedy.gh (Grasshopper 1.0.9)

pt = ConstructPoint(XCoordinate=Slider(53, range=0..100), YCoordinate=Slider(46, range=0..100), ZCoordinate=Slider(0, range=0..100))
py3 = Python3Script(nx=Slider(10, range=0..10), ny=Slider(10, range=0..10), abstand=Slider(10, range=0..10))  # -> out, punkte
# ---------- py3: Python ----------
import Rhino.Geometry as rg

punkte = []
for x in range(int(nx)):
    for y in range(int(ny)):
        punkt = rg.Point3d(x * abstand, y * abstand, 0)
        punkte.append(punkt)
# ---------- end py3 ----------
py3_2 = Python3Script(punkte=py3.punkte, groesse=Slider(8.3, range=0..10), seed=Slider(9, range=0..10))  # -> out, geometrien; inputs punkte: list of Point3d
# ---------- py3_2: Python ----------
import Rhino.Geometry as rg
import random

zufall = random.Random(int(seed))
geometrien = []

s = float(groesse)

if s > 0:
    for p in punkte:
        typ = zufall.choice(["quader", "zylinder", "kugel"])

        if typ == "quader":
            # Quadratische Grundfläche, Höhe = s
            ebene = rg.Plane(p, rg.Vector3d.ZAxis)

            quader = rg.Box(
                ebene,
                rg.Interval(-s / 2, s / 2),
                rg.Interval(-s / 2, s / 2),
                rg.Interval(0, s)
            )
            geometrien.append(quader.ToBrep())

        elif typ == "zylinder":
            # Durchmesser und Höhe = s
            ebene = rg.Plane(p, rg.Vector3d.ZAxis)
            kreis = rg.Circle(ebene, s / 2)
            zylinder = rg.Cylinder(kreis, s)

            geometrien.append(zylinder.ToBrep(True, True))

        else:
            # Durchmesser = s; Unterseite liegt am Rasterpunkt
            mitte = rg.Point3d(p.X, p.Y, p.Z + s / 2)
            kugel = rg.Sphere(mitte, s / 2)

            geometrien.append(kugel.ToBrep())
# ---------- end py3_2 ----------
py3_3 = Python3Script(base_point=pt, groesse=Slider(70, range=0..100))  # -> out, zylinder; inputs base_point: Point3d
# ---------- py3_3: Python ----------
import Rhino.Geometry as rg

zylinder = None

if base_point is not None and groesse > 0:
    hoehe = float(groesse)
    radius = hoehe / 2

    ebene = rg.Plane(base_point, rg.Vector3d.ZAxis)
    kreis = rg.Circle(ebene, radius)

    # Geschlossener Zylinder mit Boden und Deckel
    zylinder = rg.Cylinder(kreis, hoehe).ToBrep(True, True)
# ---------- end py3_3 ----------
py3_4 = Python3Script(base_point=pt, groesse=Slider(50, range=0..100))  # -> out, zylinder; inputs base_point: Point3d; same code as py3_3
py3_5 = Python3Script(base_point=pt, groesse=Slider(30, range=0..100))  # -> out, zylinder; inputs base_point: Point3d; same code as py3_3
py3_6 = Python3Script(base_point=pt, groesse=Slider(10, range=0..100))  # -> out, zylinder; inputs base_point: Point3d; same code as py3_3
colour = ColourPicker(PickedColour=RGB(255, 0, 0))
py3_7 = Python3Script(formen=py3_2.geometrien, zylinder=py3_5.zylinder)  # -> out, ergebnis, fehler; inputs formen: list of Brep, zylinder: Brep
# ---------- py3_7: Python ----------
import Rhino
import Rhino.Geometry as rg

ergebnis = []
fehler = []

toleranz = Rhino.RhinoDoc.ActiveDoc.ModelAbsoluteTolerance

if zylinder is None or not zylinder.IsSolid:
    fehler.append("Bitte einen geschlossenen Zylinder verbinden.")

else:
    schneider = zylinder.DuplicateBrep()

    if schneider.SolidOrientation == rg.BrepSolidOrientation.Inward:
        schneider.Flip()

    for i, form in enumerate(formen):
        if form is None or not form.IsSolid:
            fehler.append("Form {} ist nicht geschlossen.".format(i))
            continue

        koerper = form.DuplicateBrep()

        if koerper.SolidOrientation == rg.BrepSolidOrientation.Inward:
            koerper.Flip()

        teile = rg.Brep.CreateBooleanDifference(
            koerper, schneider, toleranz
        )

        if teile is None:
            fehler.append("Schnitt bei Form {} fehlgeschlagen.".format(i))
        else:
            ergebnis.extend(teile)
# ---------- end py3_7 ----------
py3_8 = Python3Script(formen=py3_2.geometrien, zylinder=py3_4.zylinder)  # -> out, ergebnis, fehler; inputs formen: list of Brep, zylinder: Brep; same code as py3_7
py3_9 = Python3Script(formen=py3_2.geometrien, zylinder=py3_6.zylinder)  # -> out, ergebnis, fehler; inputs formen: list of Brep, zylinder: Brep; same code as py3_7
py3_10 = Python3Script(formen=py3_2.geometrien, zylinder=py3_3.zylinder)  # -> out, ergebnis, fehler; inputs formen: list of Brep, zylinder: Brep; same code as py3_7
colour_2 = ColourPicker(PickedColour=RGB(255, 255, 0))
pt_2 = Point(Point(-24.21613576, 49.1797831, 0))
pt_3 = Point(Point(109.6422587, 46.95290296, 0))
pt_4 = Point(Point(-24.21613576, -39.38215265, 0))
pt_5 = Point(Point(109.6422587, 112.5056035, 0))
pt_6 = Point(Point(30.22644876, 106.7589869, 0))
pt_7 = Point(Point(81.99912248, -14.98902371, 0))
pt_8 = Point(Point(30.22644876, 106.7589869, 0))
pt_9 = Point(Point(81.99912248, -14.98902371, 0))
colour_3 = ColourPicker(PickedColour=RGB(0, 0, 255))
ln = Line(StartPoint=pt_2, EndPoint=pt_3)
ln_2 = Line(StartPoint=pt_4, EndPoint=pt_5)
ln_3 = Line(StartPoint=pt_6, EndPoint=pt_7)
ln_4 = Line(StartPoint=pt_8, EndPoint=pt_9)
rot3d = Rotate3D(Geometry=py3_10.ergebnis, Angle=Slider(4.1, range=0..10), Center=pt, Axis=ln)  # -> Geometry, Transform
rot3d_2 = Rotate3D(Geometry=py3_8.ergebnis, Angle=Slider(2.8, range=0..10), Center=pt, Axis=ln_2)  # -> Geometry, Transform
rot3d_3 = Rotate3D(Geometry=py3_7.ergebnis, Angle=Slider(5.3, range=0..10), Center=pt, Axis=ln_3)  # -> Geometry, Transform
rot3d_4 = Rotate3D(Geometry=py3_9.ergebnis, Angle=Slider(7, range=0..10), Center=pt, Axis=ln_4)  # -> Geometry, Transform
colour_4 = ColourPicker(PickedColour=RGB(0, 0, 0))
preview = CustomPreview(Geometry=rot3d_4.Geometry, Material=colour_4)
preview_2 = CustomPreview(Geometry=rot3d.Geometry, Material=colour)
preview_3 = CustomPreview(Geometry=rot3d_2.Geometry, Material=colour_2)
preview_4 = CustomPreview(Geometry=rot3d_3.Geometry, Material=colour_3)
