# Grasshopper definition geometry_basics.ghx (Grasshopper 1.0.8)

# ---- group: Auto-reloads cdf module on VScode changes
# Setting path for Src AutoReloader: 1. Right click on Path
# 2. Choose "Select a directory"
# 3. Locate the ..\cdf1_teaching\src folder in your computer
# NOTES:
# 
# - Use Python 3 Script blocks for your functions.
# - Import your functions and classes as: from cdf import my_function, My_class
# - Don't forget to add and name your INPUT and OUTPUT parameters that match your functions correctly. If you zoom in to the Python component you will see the + sign to add and - to remove them.
# - You need to attach the accurate components to your INPUT parameters: sliders for integers or floats, toggles or buttons for booleans, text for strings, Rhino geometries etc. etc.
# - If an INPUT is  a list, you need to right-click the parameter to set it as LIST access. Sometimes you need to also set the type of the INPUT by clicking TYPE HINT and selecting the correct input type.
# - If you want to hide an object, right-click component and uncheck Preview. To visualize again, check Preview.
# - If you get errors, READ THEM! They often tell what's wrong in a simple language. If not, copy-paste to CoPilot and don't be afraid to play around!
# 
# For more Grasshopper Help, go to:
# https://developer.rhino3d.com/guides/scripting/scripting-component/#script-inputs-and-outputs
path = FilePath()
autoreloader = Python3Script(src_path=path)  # -> out; inputs src_path: String
# ---------- autoreloader: Python ----------
#! python3
import sys, os, time
import scriptcontext as sc
import Rhino, System
from System.IO import FileSystemWatcher, NotifyFilters

VERSION = 1  
pkg = "cdf"

if not src_path:
    raise Exception("Connect a folder to src_path.")
path = os.path.normpath(src_path)
watch_dir = os.path.join(path, pkg)
if not os.path.isdir(watch_dir):
    raise Exception("No '{}' folder found in:\n{}".format(pkg, path))

def unload():
    for name in list(sys.modules):
        if name == pkg or name.startswith(pkg + "."):
            del sys.modules[name]

# Put this folder first in Python's search list
if path in sys.path:
    sys.path.remove(path)
sys.path.insert(0, path)

key = "cdf_watcher_" + str(ghenv.Component.InstanceGuid)
time_key = key + "_time"
version_key = key + "_version"

def stamp():
    sc.sticky[time_key] = time.strftime("%Y-%m-%d %H:%M:%S")

# Replace the old watcher if the folder changed or the script was updated
old = sc.sticky.get(key)
if old is not None and (os.path.normpath(old.Path) != watch_dir
                        or sc.sticky.get(version_key) != VERSION):
    old.Dispose()
    del sc.sticky[key]
    unload()

if key not in sc.sticky:
    comp = ghenv.Component
    last = [0.0]

    def reload_and_rerun():
        unload()
        stamp()
        doc = comp.OnPingDocument()
        if doc is None:            # reloader was deleted or the file closed
            return
        for obj in doc.Objects:
            if "Python" in obj.GetType().Name:
                obj.ExpireSolution(False)   # mark as out of date
        doc.NewSolution(False)              # recompute once

    def on_change(sender, e):
        if not e.FullPath.endswith(".py") or "__pycache__" in e.FullPath:
            return
        if time.time() - last[0] < 0.5:     # ignore the second event of a double save
            return
        last[0] = time.time()
        Rhino.RhinoApp.InvokeOnUiThread(System.Action(reload_and_rerun))

    w = FileSystemWatcher(watch_dir, "*.py")
    w.IncludeSubdirectories = True
    w.NotifyFilter = NotifyFilters.LastWrite
    w.Changed += on_change
    w.EnableRaisingEvents = True
    sc.sticky[key] = w
    sc.sticky[version_key] = VERSION
    stamp()                                  # time the watcher started

msg = "Last reloaded: {}\nWatching: {}".format(sc.sticky.get(time_key, "unknown"), watch_dir)
print(msg)
out = msg
# ---------- end autoreloader ----------
panel = Panel(autoreloader)

# ----
pt = Point(Point(0, 0, 0))
py3 = Python3Script(
    pt=pt,
    sx=Slider(15, range=0..100),
    sy=Slider(15, range=0..100),
    sz=Slider(15, range=0..100),
    nx=Slider(1, range=0..10),
    ny=Slider(3, range=0..10),
    nz=Slider(4, range=0..10))  # -> out, points; inputs pt: Point3d, sx: Double, sy: Double, sz: Double, nx: Int32, ny: Int32, nz: Int32
# ---------- py3: Python ----------
import Rhino.Geometry as rg

if pt is None:
    raise ValueError("Bitte einen Startpunkt mit pt verbinden.")

if any(v is None for v in [sx, sy, sz, nx, ny, nz]):
    raise ValueError("Bitte alle Eingänge verbinden.")

nx, ny, nz = int(nx), int(ny), int(nz)
sx, sy, sz = float(sx), float(sy), float(sz)

if min(nx, ny, nz) < 1:
    raise ValueError("Die Punktanzahl muss mindestens 1 sein.")

if min(sx, sy, sz) < 0:
    raise ValueError("Die Größen dürfen nicht negativ sein.")

dx = sx / (nx - 1) if nx > 1 else 0
dy = sy / (ny - 1) if ny > 1 else 0
dz = sz / (nz - 1) if nz > 1 else 0

points = [
    rg.Point3d(
        pt.X + i * dx,
        pt.Y + j * dy,
        pt.Z + k * dz
    )
    for k in range(nz)
    for j in range(ny)
    for i in range(nx)
]
# ---------- end py3 ----------
py3_2 = Python3Script(points=py3.points, seed=Slider(7, range=0..10))  # -> out, box_points, sphere_points, cylinder_points; inputs points: Point3d, seed: Int32
# ---------- py3_2: Python ----------
import random

rng = random.Random(int(seed))

box_points = []
sphere_points = []
cylinder_points = []

for pt in points:
    choice = rng.randrange(3)

    if choice == 0:
        box_points.append(pt)
    elif choice == 1:
        sphere_points.append(pt)
    else:
        cylinder_points.append(pt)
# ---------- end py3_2 ----------

pt_2 = Point()
py3_3 = Python3Script(pt=pt_2, sx=Slider(3, range=0..10), sy=Slider(10, range=0..10), sz=Slider(6, range=0..10))  # -> out, my_box; inputs pt: Point3d
# ---------- py3_3: Python ----------
import Rhino.Geometry as rg


def create_box(base_point, size_x, size_y, size_z):
    if base_point is None:
        raise ValueError("Bitte einen Punkt mit pt verbinden.")

    if size_x is None or size_y is None or size_z is None:
        raise ValueError("Bitte sx, sy und sz verbinden.")

    size_x = float(size_x)
    size_y = float(size_y)
    size_z = float(size_z)

    if size_x <= 0 or size_y <= 0 or size_z <= 0:
        raise ValueError("Alle Größen müssen größer als 0 sein.")

    plane = rg.Plane(base_point, rg.Vector3d.ZAxis)

    box = rg.Box(
        plane,
        rg.Interval(-size_x / 2, size_x / 2),
        rg.Interval(-size_y / 2, size_y / 2),
        rg.Interval(-size_z / 2, size_z / 2)
    )

    return box.ToBrep()


my_box = create_box(pt, sx, sy, sz)
# ---------- end py3_3 ----------

pt_3 = Point()
py3_4 = Python3Script(pt=pt_3, r=Slider(4, range=0..10), h=Slider(7, range=0..10))  # -> out, my_cylinder; inputs pt: Point3d
# ---------- py3_4: Python ----------
import Rhino.Geometry as rg


def create_cylinder(center, radius, height):
    if center is None:
        raise ValueError("Bitte einen Mittelpunkt mit pt verbinden.")

    if radius is None or height is None:
        raise ValueError("Bitte Radius r und Höhe h verbinden.")

    radius = float(radius)
    height = float(height)

    if radius <= 0 or height <= 0:
        raise ValueError("Radius und Höhe müssen größer als 0 sein.")

    # Unterseite um die halbe Höhe nach unten verschieben
    base_point = rg.Point3d(
        center.X,
        center.Y,
        center.Z - height / 2
    )

    plane = rg.Plane(base_point, rg.Vector3d.ZAxis)
    circle = rg.Circle(plane, radius)
    cylinder = rg.Cylinder(circle, height)

    # Beide Enden schließen
    return cylinder.ToBrep(True, True)


my_cylinder = create_cylinder(pt, r, h)
# ---------- end py3_4 ----------

pt_4 = Point()
py3_5 = Python3Script(pt=pt_4, r=Slider(4, range=0..10))  # -> out, my_sphere; inputs pt: Point3d
# ---------- py3_5: Python ----------
import Rhino.Geometry as rg


def create_sphere(base_point, radius):
    if base_point is None:
        raise ValueError("Bitte einen Mittelpunkt mit pt verbinden.")

    if radius is None:
        raise ValueError("Bitte einen Radius mit r verbinden.")

    radius = float(radius)

    if radius <= 0:
        raise ValueError("Der Radius muss größer als 0 sein.")

    sphere = rg.Sphere(base_point, radius)
    return sphere.ToBrep()


my_sphere = create_sphere(pt, r)
# ---------- end py3_5 ----------
