# Grasshopper definition versuch 1.gh (Grasshopper 1.0.8)

pt = ConstructPoint(XCoordinate=Slider(50, range=0..100), YCoordinate=Slider(46, range=0..100), ZCoordinate=Slider(0, range=0..100))
py3 = Python3Script(nx=Slider(10, range=0..10), ny=Slider(10, range=0..10), abstand=Slider(10, range=0..10))  # -> out, punkte
# ---------- py3: Python ----------
import Rhino.Geometry as rg

punkte = []
for x in range(int(nx)):
    for y in range(int(ny)):
        punkt = rg.Point3d(x * abstand, y * abstand, 0)
        punkte.append(punkt)
# ---------- end py3 ----------
py3_2 = Python3Script(punkte=py3.punkte, groesse=Slider(10, range=0..10), seed=Slider(5, range=0..10))  # -> out, geometrien; inputs punkte: list of Point3d
# ---------- py3_2: Python ----------
import Rhino.Geometry as rg
import random

zufall = random.Random(int(seed))
geometrien = []

s = float(groesse)

if s > 0:
    for p in punkte:
        typ = zufall.choice(["quader", "zylinder", "kugel"])

        if typ == "quader":
            # Quadratische Grundfläche, Höhe = s
            ebene = rg.Plane(p, rg.Vector3d.ZAxis)

            quader = rg.Box(
                ebene,
                rg.Interval(-s / 2, s / 2),
                rg.Interval(-s / 2, s / 2),
                rg.Interval(0, s)
            )
            geometrien.append(quader.ToBrep())

        elif typ == "zylinder":
            # Durchmesser und Höhe = s
            ebene = rg.Plane(p, rg.Vector3d.ZAxis)
            kreis = rg.Circle(ebene, s / 2)
            zylinder = rg.Cylinder(kreis, s)

            geometrien.append(zylinder.ToBrep(True, True))

        else:
            # Durchmesser = s; Unterseite liegt am Rasterpunkt
            mitte = rg.Point3d(p.X, p.Y, p.Z + s / 2)
            kugel = rg.Sphere(mitte, s / 2)

            geometrien.append(kugel.ToBrep())
# ---------- end py3_2 ----------
py3_3 = Python3Script(base_point=pt, groesse=Slider(81, range=0..100))  # -> out, zylinder; inputs base_point: Point3d
# ---------- py3_3: Python ----------
import Rhino.Geometry as rg

zylinder = None

if base_point is not None and groesse > 0:
    hoehe = float(groesse)
    radius = hoehe / 2

    ebene = rg.Plane(base_point, rg.Vector3d.ZAxis)
    kreis = rg.Circle(ebene, radius)

    # Geschlossener Zylinder mit Boden und Deckel
    zylinder = rg.Cylinder(kreis, hoehe).ToBrep(True, True)
# ---------- end py3_3 ----------
py3_4 = Python3Script(base_point=pt, groesse=Slider(58, range=0..100))  # -> out, zylinder; inputs base_point: Point3d; same code as py3_3
py3_5 = Python3Script(base_point=pt, groesse=Slider(33, range=0..100))  # -> out, zylinder; inputs base_point: Point3d; same code as py3_3
py3_6 = Python3Script(formen=py3_2.geometrien, zylinder=py3_5.zylinder)  # -> out, ergebnis, fehler; inputs formen: list of Brep, zylinder: Brep
# ---------- py3_6: Python ----------
import Rhino
import Rhino.Geometry as rg

ergebnis = []
fehler = []

toleranz = Rhino.RhinoDoc.ActiveDoc.ModelAbsoluteTolerance

if zylinder is None or not zylinder.IsSolid:
    fehler.append("Bitte einen geschlossenen Zylinder verbinden.")

else:
    schneider = zylinder.DuplicateBrep()

    if schneider.SolidOrientation == rg.BrepSolidOrientation.Inward:
        schneider.Flip()

    for i, form in enumerate(formen):
        if form is None or not form.IsSolid:
            fehler.append("Form {} ist nicht geschlossen.".format(i))
            continue

        koerper = form.DuplicateBrep()

        if koerper.SolidOrientation == rg.BrepSolidOrientation.Inward:
            koerper.Flip()

        teile = rg.Brep.CreateBooleanDifference(
            koerper, schneider, toleranz
        )

        if teile is None:
            fehler.append("Schnitt bei Form {} fehlgeschlagen.".format(i))
        else:
            ergebnis.extend(teile)
# ---------- end py3_6 ----------
py3_7 = Python3Script(formen=py3_2.geometrien, zylinder=py3_4.zylinder)  # -> out, ergebnis, fehler; inputs formen: list of Brep, zylinder: Brep; same code as py3_6
py3_8 = Python3Script(formen=py3_2.geometrien, zylinder=py3_3.zylinder)  # -> out, ergebnis, fehler; inputs formen: list of Brep, zylinder: Brep; same code as py3_6
